# Grasshopper definition shelf-solution.gh (Grasshopper 1.0.7)
# plug-ins: Triceratops, Swiftlet, LunchBox, Heteroptera, Pufferfish, MeshEdit Components, eleFront, Anemone

curve = Curve(<curve referenced from the Rhino model>)
offset_curve = OffsetCurve(Curve=curve, Distance=Slider(1000, range=0..1000), Corners=1)
fillet = Fillet(Curve=offset_curve, Radius=Slider(1000, range=0..1000))
brep = Brep([<brep referenced from the Rhino model> x4])
number_slider = Slider(10000, range=0..10000)
brep_join = BrepJoin(Breps=brep)  # -> Breps, Closed
relativepath = RelativePath()
file_path = FilePath("D:\04_Projects\ucl-grasshopper-web\assets\GRC_Athens.167160_IWEC.epw")  # disabled
unit_z = UnitZ(Factor="13000")
extrude = Extrude(Base=fillet, Direction=unit_z)
reverse_surface_direction = ReverseSurfaceDirection(Surface=extrude, ReverseOption=3)
panel = Panel("context")  # disabled
importepw = LBImportEPW(epw_file=file_path)  # -> location, dry_bulb_temperature, dew_point_temperature, relative_humidity, wind_speed, wind_direction, direct_normal_rad, diffuse_horizontal_rad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; disabled; plug-in component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
flip = Flip(Surface=reverse_surface_direction)  # -> Surface, Result
reference_by_layer = ReferenceByLayer(LayerName=panel, lightweight=False, DisableAutoUpdate=False)  # disabled
panel_size = Slider(2000, range=0..2000)

# ----
# Annual Radiation
panel_2 = Panel("90")  # disabled
skymatrix = LBCumulativeSkyMatrix(
    north=panel_2,
    location=importepw.location,
    direct_rad=importepw.direct_normal_rad,
    diffuse_rad=importepw.diffuse_horizontal_rad)  # -> report, sky_mtx; disabled; plug-in component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

U = Panel("""1
2
3
4
5
6""")
V = Panel("""1
2
3
4
5
6""")
height = Panel("""600
1200
1800""")
width = Panel("""600
1200
1800""")
reverse_surface_direction_2 = ReverseSurfaceDirection(Surface=reverse_surface_direction, ReverseOption=3)
surface = Surface(reparameterize(flatten(reverse_surface_direction_2)))
dimensions = Dimensions(Surface=surface)  # -> UDimension, VDimension
number_slider_2 = Slider(0.5, range=0..1)  # disabled
multiplication = Multiplication(A=panel_size, B="0.866")
subtraction = Subtraction(B=0.5)  # disabled
toggle = BooleanToggle(True)  # disabled
merge = Merge(Data1=reference_by_layer, Data2=brep_join.Breps)  # disabled
mesh = Mesh(reference_by_layer)  # disabled

# ---- group: Get the shattered dimensions for the centered panels
shatter_parameters = ShatterParameters(dimension=dimensions.UDimension, size=panel_size)  # -> floor, result
shatter_parameters_2 = ShatterParameters(dimension=dimensions.VDimension, size=multiplication)  # -> floor, result

# ----
# Visualize Sky Matrix
skydome = LBSkyDome(sky_mtx=skymatrix.sky_mtx, scale=number_slider_2)  # -> report, mesh, compass, legend, title, patch_vecs, patch_values, mesh_values, vis_set; disabled; plug-in component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

max_options = GhPythonScript(Width=width, Height=height, U=U, V=V)  # -> simplify(Result); inputs Width: list of Int32, Height: list of Int32, U: list of Int32, V: list of Int32
# ---------- max_options: Python ----------
__author__ = "Paul"
__version__ = "2024.10.21"

import rhinoscriptsyntax as rs
import ghpythonlib.treehelpers as th
from itertools import product

tree = []

items = [Width, Height, U, V]

for item in product(*items):
    tree.append(item)


Result = th.list_to_tree(tree, source=[0,0])
# ---------- end max_options ----------
mesh_join = MeshJoin(Meshes=mesh)  # disabled
mesh_2 = Mesh(merge)  # disabled
height_2 = Slider(15, range=0..1000)
mesh_join_2 = MeshJoin(Meshes=mesh_2)  # disabled
tree_statistics = TreeStatistics(Tree=max_options)  # -> Paths, Length, Count
mesh_3 = Mesh(skydome.mesh)  # disabled
working_surface = WorkingSurface(surface=surface, parameters_u=shatter_parameters.result, parameters_v=shatter_parameters_2.result)
width_2 = Slider(200, range=0..1000)
thickness = Number(height_2)
height_3 = Slider(506, range=0..1000)
mesh_flip = MeshFlip(Mesh=mesh_3)  # disabled
meshbasicmaterial = MeshBasicMaterial(Color=RGB(255, 255, 255))  # disabled
loop_start = LoopStart(Repeat=expr("x-1", tree_statistics.Count), Trigger=Button())  # -> port, Counter, Valid, Data, Width, Height, Data_2, Data_3, Data_4
depth = Number(width_2)
grid_layout = GridLayout(surface=working_surface, u_divisions=shatter_parameters.floor, v_divisions=shatter_parameters_2.floor)  # -> graft(renumbered_data)

surface_2 = Surface(grid_layout)
deconstruct_plane = DeconstructPlane(Plane=surface_2)  # -> Origin, XAxis, YAxis, ZAxis
amplitude = Amplitude(Vector=deconstruct_plane.ZAxis, Amplitude="500")
extrude_2 = Extrude(Base=surface_2, Direction=amplitude)

simple_mesh = SimpleMesh(Brep=grid_layout)  # -> flatten(Mesh)
simple_mesh_2 = SimpleMesh(Brep=extrude_2)  # -> flatten(Mesh)
list_length = ListLength(List=simple_mesh)

# ----
# Run Radiation Study
geo = Geometry(mesh_join_2)  # disabled
geo_2 = Geometry(simple_mesh)  # disabled
panel_3 = Panel("0.1")  # disabled
panel_4 = Panel("1")  # disabled
incidentradiation = LBIncidentRadiation(
    sky_mtx=skymatrix.sky_mtx,
    geometry=flatten(geo_2),
    context=flatten(geo),
    grid_size=panel_4,
    offset_dist=panel_3,
    run=toggle)  # -> report, points, results, total, mesh, legend, title, int_mtx; disabled; plug-in component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

number = Number(incidentradiation.results)  # disabled
mesh_4 = Mesh(incidentradiation.mesh)  # disabled
construct_domain = ConstructDomain(DomainStart=expr("-x/2", depth), DomainEnd=expr("x/2", depth))
panel_5 = Panel(loop_start.Counter)
meshvertexcolors = MeshVertexColors(Mesh=mesh_flip, Material=meshbasicmaterial, DecimalAccuracy=3)  # disabled
tree_branch = TreeBranch(Tree=max_options, Path=loop_start.Counter, MaintainPaths=True)
list_item = ListItem(List=tree_branch, Index=0, Wrap=False)  # -> Item, Item1, Item2, Item3
U_2 = Integer(list_item.Item2)
width_3 = Number(list_item.Item)
V_2 = Integer(list_item.Item3)
expression = Expression(x=width_3, y=thickness, Expression="y/x")
height_4 = Number(list_item.Item1)
expression_2 = Expression(x=height_4, y=thickness, Expression="(x-y)/x")
number_2 = Number(height_4)
construct_domain_2 = ConstructDomain(DomainStart=expr("-x/2", width_3), DomainEnd=expr("x/2", width_3))
construct_domain_3 = ConstructDomain(DomainStart=expression, DomainEnd=1)
construct_domain_4 = ConstructDomain(DomainStart=expr("-x/2", number_2), DomainEnd=expr("x/2", number_2))
construct_domain_5 = ConstructDomain(DomainStart=0, DomainEnd=expression_2)
range = Range(Domain=construct_domain_3, Steps=expr("x-1", U_2))
domain_box = DomainBox(Base=PlaneXY(0, 0, 0), X=construct_domain, Y=construct_domain_2, Z=construct_domain_4)
range_2 = Range(Domain=construct_domain_5, Steps=expr("x-1", V_2))
evaluate_box = EvaluateBox(Box=domain_box, UParameter=0.5, VParameter=0.5, WParameter=range_2)  # -> Plane, Point, Include
evaluate_box_2 = EvaluateBox(Box=domain_box, UParameter=0.5, VParameter=range, WParameter=0.5)  # -> Plane, Point, Include
deconstruct_plane_2 = DeconstructPlane(Plane=evaluate_box_2.Plane)  # -> Origin, XAxis, YAxis, ZAxis
rectangle = Rectangle(Plane=evaluate_box.Plane, XSize=construct_domain, YSize=construct_domain_2, Radius=0)  # -> Rectangle, Length
surface_3 = Surface(reparameterize(grid_layout))
unit_z_2 = UnitZ(Factor=1)
construct_plane = ConstructPlane(Origin=deconstruct_plane_2.Origin, XAxis=Vector(1, 0, 0), YAxis=unit_z_2)
rectangle_2 = Rectangle(Plane=construct_plane, XSize=construct_domain, YSize=construct_domain_4, Radius=0)  # -> Rectangle, Length
box_rectangle = BoxRectangle(Rectangle=rectangle_2.Rectangle, Height=thickness)
box_rectangle_2 = BoxRectangle(Rectangle=rectangle.Rectangle, Height=thickness)
surface_4 = Surface(reparameterize(surface_3))
merge_2 = Merge(Data1=box_rectangle, Data2=box_rectangle_2)  # -> flatten(Result)
brep_join_2 = BrepJoin(Breps=merge_2)  # -> Breps, Closed
discontinuity = Discontinuity(Curve=surface_4, Level=1)  # -> Points, Parameters
mesh_brep = MeshBrep(
    Brep=brep_join_2.Breps,
    Settings={GridMaxCount=0, GridMinCount=16, JaggedSeams=False, MaxEdgeLength=0, MinEdgeLength=0.0001, MinTolerance=0, Refine=True, RefineAngle=0, RelativeTolerance=0.65, SimplePlanes=True, Tolerance=0})
expression_3 = Expression(size=width_3, count=U_2, thickness=thickness, Expression="(size - thickness * count)/ (count - 1)")
expression_4 = Expression(size=height_4, count=V_2, thickness=thickness, Expression="(size - thickness * count)/ (count - 1)")

hex_to_color = HexToColor(Hex="e67e22")
colour = Colour(hex_to_color)

list_item_2 = ListItem(List=simplify(discontinuity.Points), Index=0, Wrap=True)  # -> Item, Item1, Item2
mesh_join_3 = MeshJoin(Meshes=mesh_brep)
centroid = Centroid(PointA=list_item_2.Item, PointB=list_item_2.Item1, PointC=list_item_2.Item2)  # -> Centroid, MedianAB, MedianBC, MedianCA
surface_closest_point = SurfaceClosestPoint(Point=centroid.Centroid, Surface=surface_4)  # -> Point, UVPoint, Distance
evaluate_surface = EvaluateSurface(Surface=reparameterize(surface_4), Point=surface_closest_point.UVPoint)  # -> Point, Normal, UDirection, VDirection, Frame
equality = Equality(FirstNumber=tree_statistics.Count, SecondNumber=expr("x+1", loop_start.Counter))  # -> Equality, Inequality

meshstandardmaterial = MeshStandardMaterial(Color=colour, Opacity=1, Roughness=1, Metalness=0.5, Emissive=RGB(0, 0, 0), EmissiveIntensity=1)

mesh_5 = Mesh(mesh_join_3)
larger_than = LargerThan(FirstNumber=expression_3, SecondNumber="100")  # -> LargerThan, OrEqualTo
larger_than_2 = LargerThan(FirstNumber=expression_4, SecondNumber="100")  # -> LargerThan, OrEqualTo
point = Point(Point(66113.82079, 49427.97937, 42264.39656))
spotlight = SpotLight(
    Position=point,
    Color=RGB(255, 255, 255),
    Intensity=Slider(1, range=0..10),
    Angle=Slider(207, range=0..1000),
    Distance=0,
    Decay=Slider(0.1, range=0..1),
    CastShadow=True)  # -> Helper, Light
gate_and = GateAnd(A=larger_than.OrEqualTo, B=larger_than_2.OrEqualTo)
valid = Boolean(gate_and)
loop_end = LoopEnd(
    port=loop_start.port,
    Exit=False,
    Valid=valid,
    Data=mesh_5,
    Width=list_item.Item,
    Height=list_item.Item1,
    Data_2=U_2,
    Data_3=V_2,
    Data_4=loop_start.Counter,
    TimeOutVal=0,
    pausedState=False,
    state="Constant & Record")  # -> simplify(flatten(Valid)), simplify(flatten(Mesh)), simplify(flatten(Width)), simplify(flatten(Height)), simplify(flatten(U)), simplify(flatten(V)), simplify(flatten(ID))

cull_pattern = CullPattern(List=loop_end.Height, CullPattern=loop_end.Valid)  # -> graft(List)
cull_pattern_2 = CullPattern(List=loop_end.Width, CullPattern=loop_end.Valid)  # -> graft(List)
cull_pattern_3 = CullPattern(List=loop_end.U, CullPattern=loop_end.Valid)  # -> graft(List)
cull_pattern_4 = CullPattern(List=loop_end.V, CullPattern=loop_end.Valid)  # -> graft(List)
cull_pattern_5 = CullPattern(List=loop_end.Mesh, CullPattern=loop_end.Valid)  # -> graft(List)

cull_pattern_6 = CullPattern(List=loop_end.ID, CullPattern=loop_end.Valid)  # -> graft(List)
tree_statistics_2 = TreeStatistics(Tree=cull_pattern_5)  # -> Paths, Length, Count
duplicate_data = DuplicateData(Data="1", Number=tree_statistics_2.Count, Order=True)  # -> graft(Data)
cull_pattern_7 = CullPattern(List=duplicate_data, CullPattern=loop_end.Valid)
merge_3 = Merge(
    Data1=simplify(cull_pattern_6),
    Data2=simplify(cull_pattern_7),
    Data3=simplify(cull_pattern_2),
    Data4=simplify(cull_pattern),
    Data5=simplify(cull_pattern_3),
    Data6=simplify(cull_pattern_4))

panel_6 = Panel("""ID
Width
Height
U
V""")
duplicate_data_2 = DuplicateData(Data=panel_6, Number=tree_statistics_2.Count, Order=True)
list_length_2 = ListLength(List=panel_6)
partition_list = PartitionList(List=duplicate_data_2, Size=list_length_2)  # -> simplify(Chunks)
tree_statistics_3 = TreeStatistics(Tree=partition_list)  # -> Paths, Length, Count
cull_pattern_8 = CullPattern(List=tree_statistics_3.Paths, CullPattern=flatten(loop_end.Valid))

clean_tree = CleanTree(RemoveNulls=True, RemoveInvalid=True, RemoveEmpty=True, Tree=merge_3)
split_tree = SplitTree(Data=partition_list, Masks=flatten(cull_pattern_8))  # -> Positive, Negative
userdata = UserData(Keys=split_tree.Positive, Values=clean_tree)
stream_filter = StreamFilter(Gate=equality.Equality, Stream1=cull_pattern_5)
stream_filter_2 = StreamFilter(Gate=equality.Equality, Stream1=userdata)
match_tree = MatchTree(Tree=stream_filter_2, Guide=stream_filter)
mesh_6 = Mesh(Mesh=simplify(stream_filter), Name="shelf", Material=meshstandardmaterial, DecimalAccuracy=5, UserData=match_tree)  # -> simplify(flatten(Geometry))
hempispherelight = HempisphereLight(Color=RGB(135, 206, 250), GroundColor=RGB(210, 180, 140), Intensity=Slider(1.02, range=0..10))
ambientlight = AmbientLight(Color=RGB(255, 255, 255), Intensity=Slider(1.02, range=0..10))
merge_4 = Merge(Data1=mesh_6, Data2=hempispherelight, Data3=spotlight.Light, Data4=ambientlight)
fog = Fog(Color=ColourSwatch(SwatchColor=RGB(0, 0, 0)), Near=Slider(500, range=0..1000), Far="80000")
compile_scene = CompileScene(Objects=flatten(merge_4), BackgroundColor=ColourSwatch(SwatchColor=RGB(48, 48, 48)), Fog=fog)
brep_edges = BrepEdges(Brep=working_surface)  # -> Naked, Interior, NonManifold

# ----
# Get your API key at
# https://platform.openai.com/account/api-keys
api_key = Panel("YOUR API KEY HERE")  # disabled

model = Panel("gpt-3.5-turbo")  # disabled
temperature = Slider(0.7, range=0..1)  # disabled
prompt = Panel("Why did the chicken cross the road?")  # disabled
role = Panel("user")  # disabled
cjv = CreateJSONValue(Value=role)  # disabled
cjv_2 = CreateJSONValue(Value=prompt)  # disabled
keys = Panel("""role
content""")  # disabled
merge_5 = Merge(Data1=cjv, Data2=cjv_2)  # disabled
cjo = CreateJSONObject(Keys=keys, Values=merge_5)  # disabled
keys_2 = Panel("""model
messages
temperature""")  # disabled
cja = CreateJSONArray(JTokens=cjo)  # disabled
cjv_3 = CreateJSONValue(Value=model)  # disabled
cjv_4 = CreateJSONValue(Value=temperature)  # disabled
merge_6 = Merge(Data1=cjv_3, Data2=cja, Data3=cjv_4)  # disabled
text_completion_url = Panel("https://api.openai.com/v1/chat/completions")  # disabled
cjo_2 = CreateJSONObject(Keys=keys_2, Values=merge_6)  # disabled
ctb = CreateTextBody(
    Content=cjo_2,
    IsHtmlChecked=False,
    IsJavascriptChecked=False,
    IsJsonChecked=True,
    IsTextChecked=False,
    IsXmlChecked=False)  # disabled
bearer = BearerTokenAuth(Token=api_key)  # disabled
post = POSTRequest(URL=text_completion_url, Body=ctb, Headers=bearer)  # -> Status, Content, Response; disabled
pjs = ParseJSONString(Text=post.Content)  # disabled
panel_7 = Panel("choices")  # disabled
gjok = GetJSONObjectKey(JObject=pjs, Key=panel_7)  # disabled
panel_8 = Panel("message")  # disabled
rja = ReadJSONArray(Array=gjok)  # disabled
panel_9 = Panel("content")  # disabled
gjok_2 = GetJSONObjectKey(JObject=rja, Key=panel_8)  # disabled
gjok_3 = GetJSONObjectKey(JObject=gjok_2, Key=panel_9)  # disabled
rjv = ReadJSONValue(JValue=gjok_3)  # -> AsString, AsNumber, AsBool; disabled
response = Panel(rjv.AsString)  # disabled

relativepath_2 = RelativePath()
text_split = TextSplit(Text=relativepath_2, Separators="/")
cull_index = CullIndex(List=text_split, Indices=-1, Wrap=True)
text_join = TextJoin(Text=cull_index, Join="/")
merge_7 = Merge(Data1=flatten(text_join), Data2=flatten("assets"))  # -> flatten(Result)
text_join_2 = TextJoin(Text=merge_7, Join="/")

boolean = Boolean(equality.Equality)
serializeobject = SerializeObject(Object3d=compile_scene, Minify=False, Run=boolean)
number_3 = Number(number)
join_curves = JoinCurves(Curves=brep_edges.Naked, Preserve=False)
min_offset = Number(Slider(100, range=0..100))
max_offset = Number(Slider(500, range=0..1000))
construct_domain_6 = ConstructDomain(DomainStart=min_offset, DomainEnd=max_offset)

min_max = MinMax(Number=number_3)  # -> Minimum, Maximum
construct_domain_7 = ConstructDomain(DomainStart=0, DomainEnd=min_max.Maximum)
remap_numbers = RemapNumbers(Value=number_3, Source=construct_domain_7, Target=construct_domain_6)  # -> Mapped, Clipped

divide_length = DivideLength(Curve=join_curves, Length=Slider(200, range=0..1000))  # -> Points, Tangents, Parameters
brep_join_3 = BrepJoin(Breps=flatten(grid_layout))  # -> Breps, Closed
remap_numbers_2 = RemapNumbers(Value=number_3, Source=construct_domain_7, Target=Domain(0, 1))  # -> Mapped, Clipped
brep_edges_2 = BrepEdges(Brep=brep_join_3.Breps)  # -> Naked, Interior, NonManifold
write_text_file = WriteTextFile(Path=text_join_2, FileName="shelf.json", Data=serializeobject, Write=boolean)
length = Length(Curve=centroid.MedianCA)  # -> expr("x/4", Length)
polyline = PolyLine(Vertices=divide_length.Points, Closed=True)
linebasicmaterial = LineBasicMaterial(Color=ColourSwatch(SwatchColor=RGB(171, 171, 171)), LineWidth=Slider(0.5, range=0..1))
match_tree_2 = MatchTree(Tree=graft(remap_numbers.Mapped), Guide=length)
match_tree_3 = MatchTree(Tree=graft(remap_numbers_2.Mapped), Guide=length)
line = Line(Line=[brep_edges_2.Naked, brep_edges_2.Interior], LineMaterial=linebasicmaterial, DecimalAccuracy=3)
height_5 = Number(match_tree_2)
amplitude_2 = Amplitude(Vector=evaluate_surface.Normal, Amplitude=height_5)
move = Move(Geometry=centroid.Centroid, Motion=amplitude_2)  # -> Geometry, Transform
line_2 = Line(StartPoint=centroid.Centroid, EndPoint=move.Geometry)
line_3 = Line(StartPoint=move.Geometry, EndPoint=discontinuity.Points)
perp_frame = PerpFrame(Curve=reparameterize(line_2), Parameter=Slider(0.5, range=0..1))
list_item_3 = ListItem(List=line_3, Index=0, Wrap=True)  # -> Item, Item1, Item2
linebasicmaterial_2 = LineBasicMaterial(Color=ColourSwatch(SwatchColor=RGB(255, 255, 255)), LineWidth=Slider(1, range=0..10))
panel_10 = Panel(match_tree_2)
subtraction_2 = Subtraction(A="1", B=match_tree_3)
line_4 = Line(Line=polyline, LineMaterial=linebasicmaterial_2, DecimalAccuracy=3)
hex_to_color_2 = HexToColor(Hex="e67e22")
colour_swatch = ColourSwatch(SwatchColor=RGB(217, 217, 217))
offset = Number(subtraction_2)

length_2 = Length(Curve=centroid.MedianCA)  # -> expr("x/4", Length)
multiplication_2 = Multiplication(A=length_2, B=offset)
offset_curve_2 = OffsetCurve(Curve=surface_4, Distance=expr("-x", multiplication_2), Corners=1)  # -> simplify(Curve)
explode = Explode(Curve=offset_curve_2, Recursive=True)  # -> reparameterize(simplify(Segments)), Vertices
curve_middle = CurveMiddle(Curve=explode.Segments)

line_5 = Line(StartPoint=move.Geometry, EndPoint=curve_middle)
list_item_4 = ListItem(List=line_5, Index=0, Wrap=True)  # -> Item, Item1, Item2
merge_8 = Merge(
    Data1=simplify(list_item_3.Item),
    Data2=simplify(list_item_4.Item),
    Data3=simplify(list_item_3.Item1),
    Data4=simplify(list_item_4.Item1),
    Data5=simplify(list_item_3.Item2),
    Data6=simplify(list_item_4.Item2))
line_plane = LinePlane(Line=merge_8, Plane=perp_frame)  # -> Point, ParamL, ParamP
clean_tree_2 = CleanTree(RemoveNulls=True, RemoveInvalid=True, RemoveEmpty=True, Tree=line_plane.Point)
end_points = EndPoints(Curve=merge_8)  # -> Start, End
polyline_2 = PolyLine(Vertices=clean_tree_2, Closed=True)
polyline_3 = PolyLine(Vertices=reverse(end_points.End), Closed=True)
project = Project(Geometry=polyline_2, Plane=evaluate_surface.Frame)  # -> Geometry, Transform
merge_9 = Merge(Data1=simplify(polyline_3), Data2=simplify(polyline_2))
color_to_hex = ColorToHex()
colour_2 = Colour(hex_to_color_2)
compatibilize_polylines = CompatibilizePolylines(Polylines=merge_9)  # -> Compatibilized, ResultBoolean
meshstandardmaterial_2 = MeshStandardMaterial(Color=colour_2, Opacity=1, Roughness=1, Metalness=0.5, Emissive=RGB(0, 0, 0), EmissiveIntensity=1)
panel_11 = Panel("""corridor
toilets
kitchen
lift
stairs
units""")
panel_12 = Panel(offset)
loft = Loft(
    Curves=reparameterize(compatibilize_polylines.Compatibilized),
    Options={Adjust=True, Closed=False, LoftEnds=0, LoftSimp=0, LoftType=3, Rebuild=10, Refit=0.01})
loft_2 = Loft(
    Curves=[project.Geometry, polyline_2],
    Options={Adjust=False, Closed=False, LoftEnds=0, LoftSimp=0, LoftType=0, Rebuild=10, Refit=0.01})
surface_split = SurfaceSplit(Surface=simplify(polyline_3), Curves=simplify(project.Geometry))
meshstandardmaterial_3 = MeshStandardMaterial(
    Color=ColourSwatch(SwatchColor=RGB(97, 97, 97)),
    Opacity=1,
    Roughness=1,
    Metalness=0.5,
    Emissive=RGB(0, 0, 0),
    EmissiveIntensity=1)
spaces = Spaces(layer=graft(panel_11))  # -> flatten(geometry)
envelope = Envelope(layer=graft("envelope"))  # -> flatten(geometry)
list_item_5 = ListItem(List=surface_split, Index=0, Wrap=True)
merge_10 = Merge(Data1=simplify(list_item_5), Data2=simplify(loft), Data3=simplify(loft_2))
meshnormalmaterial = MeshNormalMaterial(Wireframe=False, WireframeLineJoin="round", WireframeLineWidth=1)
brep_join_4 = BrepJoin(Breps=merge_10)  # -> Breps, Closed
panel_13 = Panel("true")
clean_tree_3 = CleanTree(RemoveNulls=True, RemoveInvalid=True, RemoveEmpty=True, Tree=brep_join_4.Breps)  # -> flatten(Tree)
duplicate_data_3 = DuplicateData(Data="solarValue", Number=list_length, Order=True)  # -> graft(Data)
duplicate_data_4 = DuplicateData(Data=number, Number=list_length, Order=True)  # -> graft(Data)
duplicate_data_5 = DuplicateData(Data="selectable", Number=list_length, Order=True)  # -> graft(Data)
duplicate_data_6 = DuplicateData(Data="true", Number=list_length, Order=True)  # -> graft(Data)
number_slider_3 = Slider(10000, range=0..10000)  # disabled
panel_14 = Panel("50000")  # disabled
mesh_7 = Mesh(Mesh=flatten(mesh_join), Material=meshstandardmaterial_3, DecimalAccuracy=5)
custom_preview = CustomPreview(
    Geometry=clean_tree_3,
    Material={diffuse=RGB(221, 160, 221), emission=RGB(66, 48, 66), shine=0.5, specular=RGB(255, 255, 255), transparency=0})
fog_2 = Fog(Color=ColourSwatch(SwatchColor=RGB(0, 0, 0)), Near=Slider(646, range=0..1000), Far="80000")
construct_domain_8 = ConstructDomain(DomainStart=expr("-x", panel_14), DomainEnd=panel_14)  # disabled
number_4 = Number(graft(number))
meshnormalmaterial_2 = MeshNormalMaterial(Wireframe=False, WireframeLineJoin="round", WireframeLineWidth=1)
relativepath_3 = RelativePath()
rectangle_3 = Rectangle(Plane=PlaneXY(0, 0, 0), XSize=construct_domain_8, YSize=construct_domain_8, Radius=0)  # -> Rectangle, Length; disabled
shadowmaterial = ShadowMaterial(Color=RGB(0, 0, 0), Opacity=1)  # disabled
userdata_2 = UserData(Keys=[duplicate_data_5, duplicate_data_3], Values=[duplicate_data_6, number_4])
surface_5 = Surface(rectangle_3.Rectangle)  # disabled
text_split_2 = TextSplit(Text=relativepath_3, Separators="/")
mesh_8 = Mesh(Mesh=graft(clean_tree_3), Material=meshstandardmaterial_2, DecimalAccuracy=5, UserData=userdata_2)  # -> flatten(Geometry)
cull_index_2 = CullIndex(List=text_split_2, Indices=-1, Wrap=True)
mesh_9 = Mesh(surface_5)  # disabled
mesh_10 = Mesh(Mesh=mesh_9, Material=shadowmaterial, DecimalAccuracy=3)  # disabled
compile_scene_2 = CompileScene(
    Objects=flatten([mesh_8, line, line_4, spaces, mesh_10, envelope, meshvertexcolors, mesh_7]),
    BackgroundColor=ColourSwatch(SwatchColor=RGB(48, 48, 48)),
    Fog=fog_2)
serializeobject_2 = SerializeObject(Object3d=compile_scene_2, Minify=False, Run=Toggle(True))
text_join_3 = TextJoin(Text=cull_index_2, Join="/")
merge_11 = Merge(Data1=flatten(text_join_3), Data2=flatten("assets"))  # -> flatten(Result)
text_join_4 = TextJoin(Text=merge_11, Join="/")
panel_15 = Panel("D:\04_Projects\ucl-grasshopper-web\index.html")
write_text_file_2 = WriteTextFile(Path=text_join_4, FileName="facade.json", Data=serializeobject_2, Write=Toggle(True))
httpserver = HTTPServer(Path=text_join_3, Run=Button(ExpressionNormal="True", ExpressionPressed="False"))

# ==== cluster ShatterParameters
size = ClusterInput()
dimension = ClusterInput()
size_2 = Number(size)
dimension_2 = Number(dimension)
division = Division(A=dimension_2, B=size_2)
round = Round(Number=division)  # -> Nearest, Floor, Ceiling
subtraction = Subtraction(A=division, B=round.Floor)
multiplication = Multiplication(A=size_2, B=subtraction)
expression = Expression(panel=multiplication, surface=dimension_2, Expression="(panel/surface)/2")
x_minus_one = XMinusOne(NumberX=expression)
absolute = Absolute(Value=x_minus_one)
merge = Merge(Data1="0", Data2=expression, Data3=absolute, Data4="1")
floor = ClusterOutput(round.Floor)
result = ClusterOutput(merge)

# ==== cluster Spaces
layer = ClusterInput()
layer_2 = Text(layer)
panel = Panel(layer_2)
elefront_layer = EleFrontLayer(Layer=layer_2)  # -> Layer, FullPath, Hidden, Locked, DisplayColour, MaterialName, Linetype, PrintColour, PrintWidth
reference_by_layer = ReferenceByLayer(LayerName=layer_2, lightweight=False, DisableAutoUpdate=True)
settings_speed = SettingsSpeed()
mesh_brep = MeshBrep(Brep=reference_by_layer, Settings=settings_speed)
meshstandardmaterial = MeshStandardMaterial(
    Color=elefront_layer.DisplayColour,
    Opacity=Slider(0.44, range=0..1),
    Roughness=1,
    Metalness=0.5,
    Emissive=elefront_layer.DisplayColour,
    EmissiveIntensity=1)
userdata = UserData(Keys="level", Values=Slider(0, range=0..100))
mesh = Mesh(Mesh=simplify(mesh_brep), Material=simplify(meshstandardmaterial), DecimalAccuracy=3, UserData=userdata)
geometry = ClusterOutput(mesh)

# ==== cluster Envelope
layer = ClusterInput()
layer_2 = Text(layer)
elefront_layer = EleFrontLayer(Layer=layer_2)  # -> Layer, FullPath, Hidden, Locked, DisplayColour, MaterialName, Linetype, PrintColour, PrintWidth
reference_by_layer = ReferenceByLayer(LayerName=layer_2, lightweight=False, DisableAutoUpdate=True)
settings_speed = SettingsSpeed()
mesh_brep = MeshBrep(Brep=reference_by_layer, Settings=settings_speed)
wireframesettings = WireframeSettings(WireframeLineJoin="round", WireframeLineWidth=1)
meshstandardmaterial = MeshStandardMaterial(
    Color=elefront_layer.DisplayColour,
    Opacity=Slider(0.43, range=0..1),
    Roughness=1,
    Metalness=0.5,
    Emissive=elefront_layer.DisplayColour,
    EmissiveIntensity=1,
    Wireframe=wireframesettings)
userdata = UserData(Keys="level", Values=Slider(0, range=0..100))
mesh_edges = MeshEdges(Mesh=mesh_brep)  # -> flatten(NakedEdges), InteriorEdges, NonManifoldEdges
line = Line()
linebasicmaterial = LineBasicMaterial(Color=RGB(255, 255, 255), LineWidth=1)
line_2 = Line(Line=flatten([mesh_edges.NakedEdges, mesh_edges.InteriorEdges]), LineMaterial=linebasicmaterial, DecimalAccuracy=3)
geometry = ClusterOutput(line_2)

# ==== cluster WorkingSurface
surface = ClusterInput()
parameters_u = ClusterInput()
parameters_v = ClusterInput()
parameter_subdivide_surface = ParameterSubdivideSurface(Surface=surface, ParametersU=parameters_u, ParametersV=parameters_v)
area = Area(Geometry=parameter_subdivide_surface)  # -> Area, Centroid
sort_list = SortList(Keys=area.Area, ValuesValuesA=parameter_subdivide_surface)  # -> Keys, ValuesValuesA
list_item = ListItem(List=sort_list.ValuesValuesA, Index=-1, Wrap=True)
surface_2 = Surface(reparameterize(list_item))
surface_3 = ClusterOutput(surface_2)

# ==== cluster GridLayout
surface = ClusterInput()
u_divisions = ClusterInput()
v_divisions = ClusterInput()
diamond_panels = DiamondPanels(Surface=surface, UDivisions=expr("x*2", u_divisions), VDivisions=v_divisions)  # -> DiamondPanels, TriPanels
surface_2 = Surface(reparameterize(diamond_panels.DiamondPanels))
discontinuity = Discontinuity(Curve=surface_2, Level=1)  # -> simplify(Points), Parameters
list_item = ListItem(List=discontinuity.Points, Index=0, Wrap=True)  # -> Item, Item1, Item2, Item3
merge = Merge(Data1=list_item.Item, Data2=list_item.Item1, Data3=list_item.Item3)
merge_2 = Merge(Data1=list_item.Item2, Data2=list_item.Item1, Data3=list_item.Item3)
polyline = PolyLine(Vertices=reverse(merge_2), Closed=True)
polyline_2 = PolyLine(Vertices=merge, Closed=True)
merge_3 = Merge(Data1=polyline_2, Data2=polyline)
surface_3 = Surface(flatten(merge_3))
renumber_paths = RenumberPaths(Data=surface_3)
renumbered_data = ClusterOutput(renumber_paths)
